# Dynamo graph NaiveBayesPrediction.dyn (Dynamo 2.0.3.8810)

# group: Importing the dataset
file_path = Filename("C:\Users\SylvesterKnudsen\Desktop\UKDUG_Pandamo\DataSet_Naive_Bayes\Social_Network_Ads.xlsx")
code_block = CodeBlock { "Social_Network_Ads"; }
byExcel = DynamoPandas.Pandamo.Pandas.DataFrame.ByExcel(filePath=file_path, sheetName=code_block)

# group: Drop Not needed columns
code_block_2 = CodeBlock { ["User ID"]; }
dropColumns = DynamoPandas.Pandamo.Reshape.ReshapeDataframe.DropColumns(dataframe=byExcel, columns=code_block_2)

# group (continued): Importing the dataset
tabulate = DataframeTableNodeModel(Dataframe=dropColumns)

# group: Features / Independet variables
code_block_3 = CodeBlock { "df.iloc[: ,:-1]"; }
byExpression = DynamoPandas.Pandamo.Select.SelectRows.ByExpression(dataframe=dropColumns, expression=code_block_3)
tabulate_2 = DataframeTableNodeModel(Dataframe=byExpression)

# group: Values
toInternalDictionary = DynamoPandas.Pandamo.Pandas.DataFrame.ToInternalDictionary(dataFrame=byExpression)
code_block_4 = CodeBlock { "data"; }
valueAtKey = DesignScript.Builtin.Dictionary.ValueAtKey(dictionary=toInternalDictionary, key=code_block_4)

# group: Target / Dependent Variable
code_block_5 = CodeBlock { "Purchased"; }
code_block_6 = CodeBlock { 1; }
byContains = DynamoPandas.Pandamo.FilterDataframe.Filter.ByContains(dataframe=dropColumns, item=code_block_5, axis=code_block_6)
tabulate_3 = DataframeTableNodeModel(Dataframe=byContains)

# group: Values
toInternalDictionary_2 = DynamoPandas.Pandamo.Pandas.DataFrame.ToInternalDictionary(dataFrame=byContains)
code_block_7 = CodeBlock { "data"; }
valueAtKey_2 = DesignScript.Builtin.Dictionary.ValueAtKey(dictionary=toInternalDictionary_2, key=code_block_7)

# group: Handle Missing Values
mean = DynamoPandas.Pandamo.Information.Summary.Mean(dataframe=byExpression)
code_block_8 = CodeBlock { "EstimatedSalary"; }
valueAtKey_3 = DesignScript.Builtin.Dictionary.ValueAtKey(dictionary=mean, key=code_block_8)
fillNa = DynamoPandas.Pandamo.Reshape.ReshapeDataframe.FillNa(dataframe=byExpression, value=valueAtKey_3)
tabulate_4 = DataframeTableNodeModel(Dataframe=fillNa)

# group: Handle Categorical Values
getDummies = DynamoPandas.Pandamo.Reshape.ReshapeDataframe.GetDummies(dataframe=fillNa)
tabulate_5 = DataframeTableNodeModel(Dataframe=getDummies)

# group: Features - Traning
code_block_9 = CodeBlock { 0.8; }
sample = DynamoPandas.Pandamo.Reshape.ReshapeDataframe.Sample(dataframe=getDummies, fraction=code_block_9)
tabulate_6 = DataframeTableNodeModel(Dataframe=sample)

# group: Features - Testing
index = DynamoPandas.Pandamo.Information.BasicInformation.Index(dataframe=sample)
code_block_10 = CodeBlock(index=index) { index["index"]; }
dropRows = DynamoPandas.Pandamo.Reshape.ReshapeDataframe.DropRows(dataframe=getDummies, index=code_block_10)
tabulate_7 = DataframeTableNodeModel(Dataframe=dropRows)

# group: Target - Traning
code_block_11 = CodeBlock { 0.8; }
sample_2 = DynamoPandas.Pandamo.Reshape.ReshapeDataframe.Sample(dataframe=byContains, fraction=code_block_11)
tabulate_8 = DataframeTableNodeModel(Dataframe=sample_2)

# group: Target - Testing
index_2 = DynamoPandas.Pandamo.Information.BasicInformation.Index(dataframe=sample_2)
code_block_12 = CodeBlock(index=index_2) { index["index"]; }
dropRows_2 = DynamoPandas.Pandamo.Reshape.ReshapeDataframe.DropRows(dataframe=byContains, index=code_block_12)
tabulate_9 = DataframeTableNodeModel(Dataframe=dropRows_2)

# group: Traning Features - Values
toInternalDictionary_3 = DynamoPandas.Pandamo.Pandas.DataFrame.ToInternalDictionary(dataFrame=sample)
code_block_13 = CodeBlock { "data"; }
valueAtKey_4 = DesignScript.Builtin.Dictionary.ValueAtKey(dictionary=toInternalDictionary_3, key=code_block_13)

# group: Traning Target - Values
toInternalDictionary_4 = DynamoPandas.Pandamo.Pandas.DataFrame.ToInternalDictionary(dataFrame=sample_2)
code_block_14 = CodeBlock { "data"; }
valueAtKey_5 = DesignScript.Builtin.Dictionary.ValueAtKey(dictionary=toInternalDictionary_4, key=code_block_14)
flatten = List.Flatten(list=valueAtKey_5)

# group: Testing Features - Values
toInternalDictionary_5 = DynamoPandas.Pandamo.Pandas.DataFrame.ToInternalDictionary(dataFrame=dropRows)
code_block_15 = CodeBlock { "data"; }
valueAtKey_6 = DesignScript.Builtin.Dictionary.ValueAtKey(dictionary=toInternalDictionary_5, key=code_block_15)

# group: Naive Bayes - ML Classification
naiveBayes = DynamoPandas.Pandamo.Statistics.Stats.NaiveBayes(trainingFeatures=valueAtKey_4, trainingTarget=flatten, testFeatures=valueAtKey_6)

# group: Testing Target - Values
toInternalDictionary_6 = DynamoPandas.Pandamo.Pandas.DataFrame.ToInternalDictionary(dataFrame=dropRows_2)
code_block_16 = CodeBlock { "data"; }
valueAtKey_7 = DesignScript.Builtin.Dictionary.ValueAtKey(dictionary=toInternalDictionary_6, key=code_block_16)
flatten_2 = List.Flatten(list=valueAtKey_7)
