# Dynamo graph NaiveBayesPrediction_v2.dyn (Dynamo 2.3.0.5885)
# packages: Pandamo 1.0.0

# group: Importing the dataset
file_path = Filename(".\Social_Network_Ads.xlsx")
code_block = CodeBlock { "Social_Network_Ads"; }
byExcel = DynamoPandas.Pandamo.Pandas.DataFrame.ByExcel(filePath=file_path, sheetName=code_block)
tabulate = DataframeTableNodeModel(Dataframe=byExcel)

# group: Drop Not needed columns
code_block_2 = CodeBlock { ["User ID"]; }
dropColumns = DynamoPandas.Pandamo.Reshape.ReshapeDataframe.DropColumns(dataframe=byExcel, columns=code_block_2)
tabulate_2 = DataframeTableNodeModel(Dataframe=dropColumns)

# group: Handle Missing Values
mean = DynamoPandas.Pandamo.Information.Summary.Mean(dataframe=dropColumns)
code_block_3 = CodeBlock { "EstimatedSalary"; }
valueAtKey = DesignScript.Builtin.Dictionary.ValueAtKey(dictionary=mean, key=code_block_3)
fillNa = DynamoPandas.Pandamo.Reshape.ReshapeDataframe.FillNa(dataframe=dropColumns, value=valueAtKey)
tabulate_3 = DataframeTableNodeModel(Dataframe=fillNa)

# group: Handle Categorical Values
getDummies = DynamoPandas.Pandamo.Reshape.ReshapeDataframe.GetDummies(dataframe=fillNa)
tabulate_4 = DataframeTableNodeModel(Dataframe=getDummies)

# group: Sample Dataset - Traning
code_block_4 = CodeBlock { 0.8; }
sample = DynamoPandas.Pandamo.Reshape.ReshapeDataframe.Sample(dataframe=getDummies, fraction=code_block_4)
tabulate_5 = DataframeTableNodeModel(Dataframe=sample)

# group: Features / Independet variables - Traning Data
code_block_5 = CodeBlock { "df.iloc[: ,:-1]"; "df.loc[:, df.columns != 'Purchased']"; }
byExpression = DynamoPandas.Pandamo.Select.SelectRows.ByExpression(dataframe=sample, expression=code_block_5.out1)
tabulate_6 = DataframeTableNodeModel(Dataframe=byExpression)

# group: Target / Dependent Variable - Traning Data
code_block_6 = CodeBlock { "Purchased"; }
code_block_7 = CodeBlock { 1; }
byContains = DynamoPandas.Pandamo.FilterDataframe.Filter.ByContains(dataframe=sample, item=code_block_6, axis=code_block_7)
tabulate_7 = DataframeTableNodeModel(Dataframe=byContains)

# group: Values
toInternalDictionary = DynamoPandas.Pandamo.Pandas.DataFrame.ToInternalDictionary(dataFrame=byContains)
code_block_8 = CodeBlock { "data"; }
valueAtKey_2 = DesignScript.Builtin.Dictionary.ValueAtKey(dictionary=toInternalDictionary, key=code_block_8)

# group: Sample Dataset - Testing
index = DynamoPandas.Pandamo.Information.BasicInformation.Index(dataframe=sample)
code_block_9 = CodeBlock(index=index) { index["index"]; }
dropRows = DynamoPandas.Pandamo.Reshape.ReshapeDataframe.DropRows(dataframe=getDummies, index=code_block_9)
tabulate_8 = DataframeTableNodeModel(Dataframe=dropRows)

# group: Features / Independet variables - Testing Data
code_block_10 = CodeBlock { "df.iloc[: ,:-1]"; "df.loc[:, df.columns != 'Purchased']"; }
byExpression_2 = DynamoPandas.Pandamo.Select.SelectRows.ByExpression(dataframe=dropRows, expression=code_block_10.out1)
tabulate_9 = DataframeTableNodeModel(Dataframe=byExpression_2)

# group: Target / Dependent Variable - Testing Data
code_block_11 = CodeBlock { "Purchased"; }
code_block_12 = CodeBlock { 1; }
byContains_2 = DynamoPandas.Pandamo.FilterDataframe.Filter.ByContains(dataframe=dropRows, item=code_block_11, axis=code_block_12)
tabulate_10 = DataframeTableNodeModel(Dataframe=byContains_2)

# group: Traning Features - Values
toInternalDictionary_2 = DynamoPandas.Pandamo.Pandas.DataFrame.ToInternalDictionary(dataFrame=byExpression)
code_block_13 = CodeBlock { "data"; }
valueAtKey_3 = DesignScript.Builtin.Dictionary.ValueAtKey(dictionary=toInternalDictionary_2, key=code_block_13)

# group: Traning Target - Values
toInternalDictionary_3 = DynamoPandas.Pandamo.Pandas.DataFrame.ToInternalDictionary(dataFrame=byContains)
code_block_14 = CodeBlock { "data"; }
valueAtKey_4 = DesignScript.Builtin.Dictionary.ValueAtKey(dictionary=toInternalDictionary_3, key=code_block_14)
flatten = List.Flatten(list=valueAtKey_4)

# group: Testing Features - Values
toInternalDictionary_4 = DynamoPandas.Pandamo.Pandas.DataFrame.ToInternalDictionary(dataFrame=byExpression_2)
code_block_15 = CodeBlock { "data"; }
valueAtKey_5 = DesignScript.Builtin.Dictionary.ValueAtKey(dictionary=toInternalDictionary_4, key=code_block_15)

# group: Naive Bayes - ML Classification
naiveBayes = DynamoPandas.Pandamo.Statistics.Stats.NaiveBayes(trainingFeatures=valueAtKey_3, trainingTarget=flatten, testFeatures=valueAtKey_5)

# group: Testing Target - Values
toInternalDictionary_5 = DynamoPandas.Pandamo.Pandas.DataFrame.ToInternalDictionary(dataFrame=byContains_2)
code_block_16 = CodeBlock { "data"; }
valueAtKey_6 = DesignScript.Builtin.Dictionary.ValueAtKey(dictionary=toInternalDictionary_5, key=code_block_16)
flatten_2 = List.Flatten(list=valueAtKey_6)

watch = Watch(flatten_2)

# group: Accuracy of Model
eq = naiveBayes == watch
countTrue = List.CountTrue(list=eq)
count = List.Count(list=naiveBayes)
code_block_17 = CodeBlock(truePredictions=countTrue, numberPredictions=count) { truePredictions/numberPredictions; }
