# Dynamo graph NaiveBayesPrediction_v3.dyn (Dynamo 2.3.0.5885)
# packages: Pandamo 1.0.0

# group: Naive Bayes - ML Classification
# note: Stats - NaiveBayes

# group: Importing the dataset
file_path = Filename(".\Social_Network_Ads.xlsx")
code_block = CodeBlock { "Social_Network_Ads"; }
byExcel = DynamoPandas.Pandamo.Pandas.DataFrame.ByExcel(filePath=file_path, sheetName=code_block)  # frozen
tabulate = DataframeTableNodeModel(Dataframe=byExcel)

# group: Drop Not needed columns
code_block_2 = CodeBlock { ["User ID"]; }
dropColumns = DynamoPandas.Pandamo.Reshape.ReshapeDataframe.DropColumns(dataframe=byExcel, columns=code_block_2)
tabulate_2 = DataframeTableNodeModel(Dataframe=dropColumns)

# group: Handle Missing Values
mean = DynamoPandas.Pandamo.Information.Summary.Mean(dataframe=dropColumns)
code_block_3 = CodeBlock { "EstimatedSalary"; }
valueAtKey = DesignScript.Builtin.Dictionary.ValueAtKey(dictionary=mean, key=code_block_3)
fillNa = DynamoPandas.Pandamo.Reshape.ReshapeDataframe.FillNa(dataframe=dropColumns, value=valueAtKey)
tabulate_3 = DataframeTableNodeModel(Dataframe=fillNa)

# group: Handle Categorical Values
getDummies = DynamoPandas.Pandamo.Reshape.ReshapeDataframe.GetDummies(dataframe=fillNa)
tabulate_4 = DataframeTableNodeModel(Dataframe=getDummies)

# group: Sample Dataset - Traning
code_block_4 = CodeBlock { 0.8; }
sample = DynamoPandas.Pandamo.Reshape.ReshapeDataframe.Sample(dataframe=getDummies, fraction=code_block_4)
tabulate_5 = DataframeTableNodeModel(Dataframe=sample)

# group: Features / Independet variables - Traning Data
code_block_5 = CodeBlock { "df.iloc[: ,:-1]"; "df.loc[:, df.columns != 'Purchased']"; }
byExpression = DynamoPandas.Pandamo.Select.SelectRows.ByExpression(dataframe=sample, expression=code_block_5.out1)
tabulate_6 = DataframeTableNodeModel(Dataframe=byExpression)

# group: Target / Dependent Variable - Traning Data
code_block_6 = CodeBlock { "Purchased"; }
code_block_7 = CodeBlock { 1; }
byContains = DynamoPandas.Pandamo.FilterDataframe.Filter.ByContains(dataframe=sample, item=code_block_6, axis=code_block_7)
tabulate_7 = DataframeTableNodeModel(Dataframe=byContains)

# group: Sample Dataset - Testing
index = DynamoPandas.Pandamo.Information.BasicInformation.Index(dataframe=sample)
code_block_8 = CodeBlock(index=index) { index["index"]; }
dropRows = DynamoPandas.Pandamo.Reshape.ReshapeDataframe.DropRows(dataframe=getDummies, index=code_block_8)
tabulate_8 = DataframeTableNodeModel(Dataframe=dropRows)

# group: Features / Independet variables - Testing Data
code_block_9 = CodeBlock { "df.iloc[: ,:-1]"; "df.loc[:, df.columns != 'Purchased']"; }
byExpression_2 = DynamoPandas.Pandamo.Select.SelectRows.ByExpression(dataframe=dropRows, expression=code_block_9.out1)
tabulate_9 = DataframeTableNodeModel(Dataframe=byExpression_2)

# group: Target / Dependent Variable - Testing Data
code_block_10 = CodeBlock { "Purchased"; }
code_block_11 = CodeBlock { 1; }
byContains_2 = DynamoPandas.Pandamo.FilterDataframe.Filter.ByContains(dataframe=dropRows, item=code_block_10, axis=code_block_11)
tabulate_10 = DataframeTableNodeModel(Dataframe=byContains_2)

# group: Traning Features - Values
toInternalDictionary = DynamoPandas.Pandamo.Pandas.DataFrame.ToInternalDictionary(dataFrame=byExpression)
code_block_12 = CodeBlock { "data"; }
valueAtKey_2 = DesignScript.Builtin.Dictionary.ValueAtKey(dictionary=toInternalDictionary, key=code_block_12)

# group: Traning Target - Values
toInternalDictionary_2 = DynamoPandas.Pandamo.Pandas.DataFrame.ToInternalDictionary(dataFrame=byContains)
code_block_13 = CodeBlock { "data"; }
valueAtKey_3 = DesignScript.Builtin.Dictionary.ValueAtKey(dictionary=toInternalDictionary_2, key=code_block_13)
flatten = List.Flatten(list=valueAtKey_3)

# group: Testing Features - Values
toInternalDictionary_3 = DynamoPandas.Pandamo.Pandas.DataFrame.ToInternalDictionary(dataFrame=byExpression_2)
code_block_14 = CodeBlock { "data"; }
valueAtKey_4 = DesignScript.Builtin.Dictionary.ValueAtKey(dictionary=toInternalDictionary_3, key=code_block_14)

# group: Naive Bayes - ML Classification
naiveBayes = DynamoPandas.Pandamo.Statistics.Stats.NaiveBayes(trainingFeatures=valueAtKey_2, trainingTarget=flatten, testFeatures=valueAtKey_4)

# group: Testing Target - Values
toInternalDictionary_4 = DynamoPandas.Pandamo.Pandas.DataFrame.ToInternalDictionary(dataFrame=byContains_2)
code_block_15 = CodeBlock { "data"; }
valueAtKey_5 = DesignScript.Builtin.Dictionary.ValueAtKey(dictionary=toInternalDictionary_4, key=code_block_15)
flatten_2 = List.Flatten(list=valueAtKey_5)

watch = Watch(flatten_2)

# group: Accuracy of Model
eq = naiveBayes == watch
countTrue = List.CountTrue(list=eq)
count = List.Count(list=naiveBayes)
code_block_16 = CodeBlock(truePredictions=countTrue, numberPredictions=count) { truePredictions/numberPredictions; }

# group: Importing the dataset
# note: Dataframe
file_path_2 = Filename(".\Social_Network_Ads.xlsx")
code_block_17 = CodeBlock { "Social_Network_Ads"; }
# note: Tabulate
tabulate_11 = DataframeTableNodeModel()  # unwired: Dataframe

# group: Drop Not needed columns
# note: Reshape - DropColumns
code_block_18 = CodeBlock { ["User ID"]; }
tabulate_12 = DataframeTableNodeModel()  # unwired: Dataframe

# group: Handle Missing Values
tabulate_13 = DataframeTableNodeModel()  # unwired: Dataframe
# note: Mean Values
code_block_19 = CodeBlock { "EstimatedSalary"; }
# note: Fill NA values
valueAtKey_6 = DesignScript.Builtin.Dictionary.ValueAtKey(key=code_block_19)  # unwired: dictionary

# group: Handle Categorical Values
# note: Dummie values
tabulate_14 = DataframeTableNodeModel()  # unwired: Dataframe

# group: Target / Dependent Variable - Traning Data
code_block_20 = CodeBlock { "Purchased"; }
code_block_21 = CodeBlock { 1; }
# note: Filter - By Contains
byContains_3 = DynamoPandas.Pandamo.FilterDataframe.Filter.ByContains(item=code_block_20, axis=code_block_21)  # unwired: dataframe
tabulate_15 = DataframeTableNodeModel(Dataframe=byContains_3)

# group: Traning Target - Values
toInternalDictionary_5 = DynamoPandas.Pandamo.Pandas.DataFrame.ToInternalDictionary(dataFrame=byContains_3)
code_block_22 = CodeBlock { "data"; }
valueAtKey_7 = DesignScript.Builtin.Dictionary.ValueAtKey(dictionary=toInternalDictionary_5, key=code_block_22)
flatten_3 = List.Flatten(list=valueAtKey_7)

# group: Traning Features - Values
# note: Internal Dictionary
code_block_23 = CodeBlock { "data"; }
valueAtKey_8 = DesignScript.Builtin.Dictionary.ValueAtKey(key=code_block_23)  # unwired: dictionary

# group: Target / Dependent Variable - Testing Data
code_block_24 = CodeBlock { "Purchased"; }
code_block_25 = CodeBlock { 1; }
byContains_4 = DynamoPandas.Pandamo.FilterDataframe.Filter.ByContains(item=code_block_24, axis=code_block_25)  # unwired: dataframe
tabulate_16 = DataframeTableNodeModel(Dataframe=byContains_4)

# group: Testing Target - Values
toInternalDictionary_6 = DynamoPandas.Pandamo.Pandas.DataFrame.ToInternalDictionary(dataFrame=byContains_4)
code_block_26 = CodeBlock { "data"; }
valueAtKey_9 = DesignScript.Builtin.Dictionary.ValueAtKey(dictionary=toInternalDictionary_6, key=code_block_26)
flatten_4 = List.Flatten(list=valueAtKey_9)

watch_2 = Watch(flatten_4)

# group: Accuracy of Model
eq_2 = _ == watch_2  # unwired: x
countTrue_2 = List.CountTrue(list=eq_2)
count_2 = List.Count()  # unwired: list
code_block_27 = CodeBlock(truePredictions=countTrue_2, numberPredictions=count_2) { truePredictions/numberPredictions; }

# group: Features / Independet variables - Traning Data
# note: Select Rows - By Expression
tabulate_17 = DataframeTableNodeModel()  # unwired: Dataframe
code_block_28 = CodeBlock { "df.loc[:, df.columns != 'Purchased']"; }

# group: Features / Independet variables - Testing Data
code_block_29 = CodeBlock { "df.loc[:, df.columns != 'Purchased']"; }
byExpression_3 = DynamoPandas.Pandamo.Select.SelectRows.ByExpression(expression=code_block_29)  # unwired: dataframe
tabulate_18 = DataframeTableNodeModel(Dataframe=byExpression_3)

# group: Testing Features - Values
toInternalDictionary_7 = DynamoPandas.Pandamo.Pandas.DataFrame.ToInternalDictionary(dataFrame=byExpression_3)
code_block_30 = CodeBlock { "data"; }
valueAtKey_10 = DesignScript.Builtin.Dictionary.ValueAtKey(dictionary=toInternalDictionary_7, key=code_block_30)

# group: Sample Dataset - Traning
tabulate_19 = DataframeTableNodeModel()  # unwired: Dataframe
# note: Reshape - Sample
code_block_31 = CodeBlock { 0.8; }

# group: Sample Dataset - Testing
# note: Reshape - DropRows
tabulate_20 = DataframeTableNodeModel()  # unwired: Dataframe
# note: Basic Info - Index
code_block_32 = CodeBlock { index["index"]; }  # unwired: index
