# Dynamo graph panda.dyn (Dynamo 2.4.0.6186)
# packages: Pandamo 1.0.0

code_block = CodeBlock { {"one's":[1,11,111,11,1],"two's":[2,22,222,22,2],"three's":[3,33,333,33,3],"four's":[4,44,444,44,4]}; }
file_path = Filename(".\movies.xls")
code_block_2 = CodeBlock { "2010s"; }
code_block_3 = CodeBlock { ["object"]; }
code_block_4 = CodeBlock { {"model":["Lisa","Lisa 2","Macintosh 128K","Macintosh 512K"],"launched":[1983,1984,1984,1984],"discontinued":[1986,1985,1984,1986]}; }
keys = DesignScript.Builtin.Dictionary.Keys(dictionary=code_block_4)
reverse = List.Reverse(list=keys)
valueAtKey = DesignScript.Builtin.Dictionary.ValueAtKey(dictionary=code_block_4, key=keys)
reverse_2 = List.Reverse(list=valueAtKey)

# group: Create Dataframe
byExcel = DynamoPandas.Pandamo.Pandas.DataFrame.ByExcel(filePath=file_path, sheetName=code_block_2)  # frozen
byDictionary = DynamoPandas.Pandamo.Pandas.DataFrame.ByDictionary(dataDictionary=code_block_4)  # frozen
tabulate = DynamoPandas.Pandamo.Format.DataFrameFormatters.Tabulate(dataframe=byDictionary)
byColumnsValues = DynamoPandas.Pandamo.Pandas.DataFrame.ByColumnsValues(columns=reverse, values=reverse_2)

byDatatype = DynamoPandas.Pandamo.Select.SelectColumns.ByDatatype(dataframe=byExcel, datatypes=code_block_3)
tabulate_2 = DataframeTableNodeModel(Dataframe=byDatatype)

# group: Reshape
code_block_5 = CodeBlock { "model"; "launched"; ["discontinued"]; }
code_block_6 = CodeBlock { true; }
sortValues = DynamoPandas.Pandamo.Reshape.ReshapeDataframe.SortValues(dataframe=byDictionary, columns=code_block_5.out2, ascending=code_block_6)
code_block_7 = CodeBlock { ["model"]; ["new_models"]; }
renameColumns = DynamoPandas.Pandamo.Reshape.ReshapeDataframe.RenameColumns(dataframe=byDictionary, oldValues=code_block_7.out0, newValues=code_block_7.out1)
pivot = DynamoPandas.Pandamo.Reshape.ReshapeDataframe.Pivot(dataframe=byDictionary, index=code_block_5.out1, columns=code_block_5.out0, values=code_block_5.out2)
code_block_8 = CodeBlock { ["model"]; ["launched","discontinued"]; }
melt = DynamoPandas.Pandamo.Reshape.ReshapeDataframe.Melt(dataframe=byColumnsValues, idVar=code_block_8.out0, valueVar=code_block_8.out1)
code_block_9 = CodeBlock { [1,2]; }
dropRows = DynamoPandas.Pandamo.Reshape.ReshapeDataframe.DropRows(dataframe=byDictionary, index=code_block_9)
code_block_10 = CodeBlock { ["model","discontinued"]; }
dropColumns = DynamoPandas.Pandamo.Reshape.ReshapeDataframe.DropColumns(dataframe=byDictionary, columns=code_block_10)

code_block_11 = CodeBlock(x=byExcel) { x; }

# group: Filters
code_block_12 = CodeBlock { "Actor"; 1; }
byContains = DynamoPandas.Pandamo.FilterDataframe.Filter.ByContains(dataframe=code_block_11, item=code_block_12.out0, axis=code_block_12.out1)
code_block_13 = CodeBlock { "Budget"; 1; }
byItems = DynamoPandas.Pandamo.FilterDataframe.Filter.ByItems(dataframe=byExcel, items=code_block_13.out0, axis=code_block_13.out1)

# group: Select Rows
code_block_14 = CodeBlock { "Actor 1"; "Ryan"; }
byContains_2 = DynamoPandas.Pandamo.Select.SelectRows.ByContains(dataframe=byContains, column=code_block_14.out0, containsString=code_block_14.out1)
code_block_15 = CodeBlock { "model"; "Lisa"; }
byMatch = DynamoPandas.Pandamo.Select.SelectRows.ByMatch(dataframe=byDictionary, column=code_block_15.out0, matchString=code_block_15.out1)
code_block_16 = CodeBlock { [0]; ["launched","model"]; }
byLabel = DynamoPandas.Pandamo.Select.SelectRows.ByLabel(dataframe=byDictionary, rowLabel=code_block_16.out0, columnLabel=code_block_16.out1)
tabulate_3 = DynamoPandas.Pandamo.Format.DataFrameFormatters.Tabulate(dataframe=byLabel)
code_block_17 = CodeBlock { [1]; [2]; }
byIndex = DynamoPandas.Pandamo.Select.SelectRows.ByIndex(dataframe=byDictionary, rowIndex=code_block_17.out0)
tabulate_4 = DynamoPandas.Pandamo.Format.DataFrameFormatters.Tabulate(dataframe=byIndex)
code_block_18 = CodeBlock { "df[(df.model == 'Lisa 2') | (df.iloc[:,2] == 1984)]"; }
byExpression = DynamoPandas.Pandamo.Select.SelectRows.ByExpression(dataframe=byDictionary, expression=code_block_18)
tabulate_5 = DynamoPandas.Pandamo.Format.DataFrameFormatters.Tabulate(dataframe=byExpression)

code_block_19 = CodeBlock(x=byDictionary) { x; }

# group: BasicInformation
index = DynamoPandas.Pandamo.Information.BasicInformation.Index(dataframe=code_block_19)
columns = DynamoPandas.Pandamo.Information.BasicInformation.Columns(dataframe=code_block_19)
info = DynamoPandas.Pandamo.Information.BasicInformation.Info(dataframe=code_block_19)
count = DynamoPandas.Pandamo.Information.BasicInformation.Count(dataframe=code_block_19)
dataTypes = DynamoPandas.Pandamo.Information.BasicInformation.DataTypes(dataframe=code_block_19)

# group: Summary
median = DynamoPandas.Pandamo.Information.Summary.Median(dataframe=byDictionary)
cumulativeSum = DynamoPandas.Pandamo.Information.Summary.CumulativeSum(dataframe=byDictionary)
maxValues = DynamoPandas.Pandamo.Information.Summary.MaxValues(dataframe=byDictionary)
mean = DynamoPandas.Pandamo.Information.Summary.Mean(dataframe=byDictionary)
code_block_20 = CodeBlock { 0; }
sum = DynamoPandas.Pandamo.Information.Summary.Sum(dataframe=byDictionary, axis=code_block_20)
maxValueIndex = DynamoPandas.Pandamo.Information.Summary.MaxValueIndex(dataframe=byDictionary, axis=code_block_20)
minValueIndex = DynamoPandas.Pandamo.Information.Summary.MinValueIndex(dataframe=byDictionary, axis=code_block_20)
describe = DynamoPandas.Pandamo.Information.Summary.Describe(dataframe=byExcel)
tabulate_6 = DynamoPandas.Pandamo.Format.DataFrameFormatters.Tabulate(dataframe=describe)
unique = DynamoPandas.Pandamo.Information.Summary.Unique(dataframe=byDictionary)

python_script = Python()
# ---------- python_script.python (13 lines) ----------
# Enable Python support and load DesignScript library
import clr
clr.AddReference('ProtoGeometry')
from Autodesk.DesignScript.Geometry import *
from System import Guid
# The inputs to this node will be stored as a list in the IN variables.
dataEnteringNode = IN
guids = []
# Place your code below this line
for i in range(1169):
	guids.append(Guid.NewGuid().ToString('D'))
# Assign your output to the OUT variable.
OUT = guids
# ----------------------------------------
file_path_2 = Filename("C:\Users\SylvesterKnudsen\Documents\Copy of Greenwich Room by Room 04-10-19 R3.xlsx")
code_block_21 = CodeBlock { "Summary"; }
byExcel_2 = DynamoPandas.Pandamo.Pandas.DataFrame.ByExcel(filePath=file_path_2, sheetName=code_block_21)  # frozen
code_block_22 = CodeBlock { "df.loc[:, 'BUILDING':'OIM - Room Type']"; }
byExpression_2 = DynamoPandas.Pandamo.Select.SelectRows.ByExpression(dataframe=byExcel_2, expression=code_block_22)
count_2 = DynamoPandas.Pandamo.Information.BasicInformation.Count(dataframe=byExpression_2)
values = DesignScript.Builtin.Dictionary.Values(dictionary=count_2)
maximumItem = List.MaximumItem(list=values)
randomList = Math.RandomList(amount=maximumItem)
code_block_23 = CodeBlock { 1000; 9000; }
remapRange = Math.RemapRange(numbers=randomList, newMin=code_block_23.out0, newMax=code_block_23.out1)
floor = Math.Floor(number=remapRange)
code_block_24 = CodeBlock(guids=python_script, ids=floor) { {"Revit GUID": guids, "SF ID": ids}; }
byDictionary_2 = DynamoPandas.Pandamo.Pandas.DataFrame.ByDictionary(dataDictionary=code_block_24)
count_3 = DynamoPandas.Pandamo.Information.BasicInformation.Count(dataframe=byDictionary_2)
code_block_25 = CodeBlock { true; }
merge = DynamoPandas.Pandamo.Combine.CombineDataframe.Merge(leftDf=byExpression_2, rightDf=byDictionary_2, leftIndex=code_block_25, rightIndex=code_block_25)
tabulate_7 = DataframeTableNodeModel(Dataframe=merge)
list_create = List.Create(item0=byExpression_2, item1=byDictionary_2)
code_block_26 = CodeBlock { 1; }
concatenate = DynamoPandas.Pandamo.Combine.CombineDataframe.Concatenate(dataframes=list_create, axis=code_block_26)
tabulate_8 = DataframeTableNodeModel(Dataframe=concatenate)
code_block_27 = CodeBlock { 1169; }
tabulate_9 = DynamoPandas.Pandamo.Format.DataFrameFormatters.Tabulate(dataframe=byItems)
code_block_28 = CodeBlock { 1; }
boolean = BoolSelector(true)
reverseDataframe = DynamoPandas.Pandamo.Reshape.ReshapeDataframe.ReverseDataframe(dataframe=byExcel, axis=code_block_28, resetIndex=boolean)
fillNa = DynamoPandas.Pandamo.Reshape.ReshapeDataframe.FillNa(dataframe=byExcel)
dataTypes_2 = DynamoPandas.Pandamo.Information.BasicInformation.DataTypes(dataframe=byExcel)
getDummies = DynamoPandas.Pandamo.Reshape.ReshapeDataframe.GetDummies(dataframe=byColumnsValues)
tabulate_10 = DataframeTableNodeModel(Dataframe=getDummies)
