# Dynamo graph panda.dyn (Dynamo 2.0.2.6826)

code_block = CodeBlock { {"one's":[1,11,111,11,1],"two's":[2,22,222,22,2],"three's":[3,33,333,33,3],"four's":[4,44,444,44,4]}; }
byDictionary = DynamoPandas.Pandas.DataFrame.ByDictionary(dataDictionary=code_block)
